# Grasshopper definition DES_PoR_Tool_1.3.gh (Grasshopper 1.0.7)
# plug-ins: GH_CPython

# ----
# Inputs
# t_inter mean(expected value:lambda)=7
number_of_outpatient_dept_s = Slider(16, range=0..100)
# treatmentime mean(expected value:1/lambda)=1/5
treatmenttime = Slider(5, range=0..10)
single_room_number = Slider(20, range=0..100)
total_bed_in_multiple_rooms = Slider(40, range=0..100)
multiple_bed_delivery_rooms = Slider(10, range=0..10)
number_of_adm_personnel = Slider(20, range=0..100)
one_bed_delivery_room = Slider(12, range=0..100)
icu_beds = Slider(10, range=0..10)

# ----
# DES model & PoR calculations
des_por_tool = GH_CPython(
    NUM_DOCTORS=Slider(2, range=0..10),
    TREATMENTTIME=treatmenttime,
    T_INTER=Slider(7, range=0..10),
    OutpatientDept_Num=number_of_outpatient_dept_s,
    SingleBedRoom_Num=single_room_number,
    MultipleBedRoom_BedNum=total_bed_in_multiple_rooms,
    SingleBed_DeliveryRoom_Num=one_bed_delivery_room,
    MultipleBed_DeliveryRoom_BedNum=multiple_bed_delivery_rooms,
    ICU_BedNum=icu_beds,
    Administrative_Num=number_of_adm_personnel)  # -> output, a, b, c, d, e, f, g, h, i; inputs NUM_DOCTORS: list, TREATMENTTIME: list, T_INTER: list, SingleBedRoom_Num: list, MultipleBedRoom_BedNum: list, SingleBed_DeliveryRoom_Num: list, MultipleBed_DeliveryRoom_BedNum: list, ICU_BedNum: list, Administrative_Num: list
#   port NUM_DOCTORS: [required] - [type = int] - [default = None] Descripe your input here * bullet point. * bullet point
#   port output: indicate your output description here. refers to a new line.
# ---------- des_por_tool: Python ----------
import random
import numpy as np
import simpy

TotalBeds_Num=SingleBedRoom_Num + MultipleBedRoom_BedNum + SingleBed_DeliveryRoom_Num + MultipleBed_DeliveryRoom_BedNum + ICU_BedNum
#Area calculation of treatment rooms & waiting areas in each outpatient department
if NUM_DOCTORS == 1:
    Outpatient_Dept_Area = (16 * NUM_DOCTORS) + 12 #treatment rooms + waiting areas
elif NUM_DOCTORS == 2:
    Outpatient_Dept_Area = (16 * NUM_DOCTORS) + 24 #treatment rooms + waiting areas
elif NUM_DOCTORS > 2:
    Outpatient_Dept_Area = (16 * NUM_DOCTORS) + 24 + (5 * (NUM_DOCTORS - 2)) #treatment rooms + waiting areas


RANDOM_SEED = 50 #seed number of simulation
SIM_TIME = 480 #simulation time in minutes: 8 hours
TREATMENTTIME=5
data_wait = []
data_patientdisposed=[]

#create outpatient components
class Outpatient(object):

    def __init__(self, env, num_doctors, treatmenttime):
        self.env = env
        self.doctor = simpy.Resource(env, num_doctors)
        self.treatmenttime = treatmenttime

    def treat(self, patient):
        yield self.env.timeout(random.expovariate(1/TREATMENTTIME))

#create patient arrivals
def patient(env, name, pr):
    print('%s arrives at the outpatient department at %.2f.' % (name, env.now))
    arrivetime=env.now
    with pr.doctor.request() as request:
        yield request 
        print('%s enters the outpatient department at %.2f.' % (name, env.now))
        entertime=env.now
        yield env.process(pr.treat(name))
        print('%s leaves the outpatient department at %.2f.' % (name, env.now))
        print('%s waiting time %.2f.' % (name, entertime-arrivetime))
        data_wait.append(entertime-arrivetime)

#create treatment process
def setup(env, num_doctors, treatmenttime, t_inter): #t_inter means that one patient arrives in each t_inter minutes 
    outpatient_department = Outpatient(env, num_doctors, treatmenttime)
    #create 4 initial patients
    for i in range(4):
        env.process(patient(env, 'patient %d' % i, outpatient_department))
    #create more patients
    while True:
        yield env.timeout(np.random.poisson(t_inter)) #simulate patient arrivals in a poisson process with a lambda value of 7
        i += 1
        env.process(patient(env, 'patient %d' % i, outpatient_department))
        data_patientdisposed.append(i)

#run the simulation 
random.seed(RANDOM_SEED)  
env = simpy.Environment()
env.process(setup(env, NUM_DOCTORS, TREATMENTTIME, T_INTER))
env.run(until=SIM_TIME)
#get the outputs of DES from a,b
a=data_patientdisposed #number of patients disposed (treated) from the system
b=data_wait #number of waiting times

#calculate space requirements of hospital units
c=Outpatient_Dept_Area*OutpatientDept_Num #total area of all outpatient dept.s
d=(SingleBedRoom_Num*9)+(MultipleBedRoom_BedNum*7) #One-bed patient rooms must be min 9 m2.Patient wards must be min 7 m2 per each bed.
e=(SingleBed_DeliveryRoom_Num*12)+(MultipleBed_DeliveryRoom_BedNum*10) #One-bed delivery patient rooms must be min 12 m2.Delivery patient wards must be min 10 m2 per each bed.
f=ICU_BedNum*12 #ICU units must be min 12 m2 per each bed.
g=Administrative_Num*random.randint(8,12) #Administrative offices must be 8-12 m2 for each personnel. 
h=TotalBeds_Num+(TotalBeds_Num*0.2) #Bunker area = (number of beds) + (number of beds*20%)
#There must be min 6 elevators in 60-200 bed hospitals. 
#There must be min 9 elevators in 201-350 bed hospitals. 
if TotalBeds_Num >= 60 and TotalBeds_Num <= 200:
    MIN_ELEV = 6
elif TotalBeds_Num > 200 and TotalBeds_Num <= 350:
    MIN_ELEV = 9
i=MIN_ELEV
#get the outputs of PoR from c,d,e,f,g,h,i
# ---------- end des_por_tool ----------

# ---- group: dimensions of 2000 kg elevator
multiplication = Multiplication(A="1.5", B="2.7")

# ----
multiplication_2 = Multiplication(A=des_por_tool.i, B=multiplication)

# ----
# Outputs
# outpatient departments: Ear-Nose-Throat
# General Surgery
# Orthopedics
# Eye
# Obstetrics
# Tooth
# Urology
# Pulmonary
# Internal Medicine
# Dermatology
# Psychology
# Cardiology
# Child
# Infection
# Physiotherapy
# Neurology
required_area_m2_for_inpatient_departmen = Panel(des_por_tool.d)  # "Required area (m2) for inpatient departments"
number_of_patients_disposed_in_a_day = Panel(des_por_tool.a)
required_area_m2_for_delivery = Panel(des_por_tool.e)
required_area_m2_for_icu = Panel(des_por_tool.f)
required_area_m2_for_bunker = Panel(des_por_tool.h)
required_area_m2_for_outpatient_departme = Panel(des_por_tool.c)  # "Required area (m2) for outpatient departments"
required_area_m2_for_administration = Panel(des_por_tool.g)
waiting_time_minutes_in_the_queue_per_ea = Panel(des_por_tool.b)  # "waiting time (minutes) in the queue per each patient"
required_area_m2_for_elevators = Panel(multiplication_2)

item = ListItem(List=number_of_patients_disposed_in_a_day, Index=-1, Wrap=True)
ma = MassAddition(Input=waiting_time_minutes_in_the_queue_per_ea)  # -> Result, PartialResults
patient_disposed_in_a_day = Panel(item)
total_waiting_time = Panel(ma.Result)
total_needed_area_m2 = Panel(required_area_m2_for_outpatient_departme)
